% Simulink data dictionary Trike_dictionary.sldd

Joystick_RPDOs = Simulink.Bus()
  ButtonsStatus: uint8
  LongCmp: single
  LatCmd: single

Encoder_RPDOs = Simulink.Bus()
  Encoder_Actual_Position: uint32
  Encoder_Stored_Position: uint32

Dunk_RPDOs = Simulink.Bus()
  ActualCurrent: int32
  ActualVelocity: int32

Dunk_TPDOs = Simulink.Bus()
  ClearError: uint8
  DeviceMode: uint8
  PowerEnable: uint8
  BrakeCtrl: uint8
  DesiredCurrent: int32

Dunk_Init_TPDOs = Simulink.Bus()
  ClearError: uint8
  DeviceMode: uint8
  PowerEnable: uint8
  BrakeCtrl: uint8

CAN_BUS_A = Simulink.Bus()
  DunkA_ClearError: uint8
  DunkA_DeviceMode: uint8
  DunkA_PowerEnable: uint8
  DunkA_BrakeCtrl: uint8
  DunkA_DesiredCurrent: int32
  DunkB_ClearError: uint8
  DunkB_DeviceMode: uint8
  DunkB_PowerEnable: uint8
  DunkB_BrakeCtrl: uint8
  DunkB_DesiredCurrent: int32
  DunkC_ClearError: uint8
  DunkC_DeviceMode: uint8
  DunkC_PowerEnable: uint8
  DunkC_BrakeCtrl: uint8
  DunkC_DesiredCurrent: int32
  DunkD_ClearError: uint8
  DunkD_DeviceMode: uint8
  DunkD_PowerEnable: uint8
  DunkD_BrakeCtrl: uint8
  DunkD_DesiredCurrent: int32

CAN_BUS_B = Simulink.Bus()
  APT_ControlWord: uint8
  APT_PedalPosition: uint8
  APT_HeartBeat: uint8

APT_RPDOs = Simulink.Bus()
  StatusWord: uint8
  PhaseCurrent: int16
  Speed: int16
  BusVoltage: uint16
  MotorTemp: int8
  Temp: int8
  ErrStatus: uint8
  Direction: uint8

Dold_RPDOs = Simulink.Bus()
  Enable: uint8

AN2CAN_conv = Simulink.Bus()
  AN_01: int16
  AN_02: int16
  AN_03: int16
  AN_04: int16

Speedgoat_TPDOs = Simulink.Bus()
  APT_ControlWord: uint8
  APT_PedalPosition: uint8
  APT_HeartBeat: uint8
  DunkA_ClearError: uint8
  DunkA_DeviceMode: uint8
  DunkA_PowerEnable: uint8
  DunkA_BrakeCtrl: uint8
  DunkA_DesiredCurrent: int32
  DunkB_ClearError: uint8
  DunkB_DeviceMode: uint8
  DunkB_PowerEnable: uint8
  DunkB_BrakeCtrl: uint8
  DunkB_DesiredCurrent: int32
  DunkC_ClearError: uint8
  DunkC_DeviceMode: uint8
  DunkC_PowerEnable: uint8
  DunkC_BrakeCtrl: uint8
  DunkC_DesiredCurrent: int32
  DunkD_ClearError: uint8
  DunkD_DeviceMode: uint8
  DunkD_PowerEnable: uint8
  DunkD_BrakeCtrl: uint8
  DunkD_DesiredCurrent: int32
  Test_AN1: int16
  Test_AN2: int16
  Test_AN3: int16
  Test_AN4: int16

Inclinometer_RPDOs = Simulink.Bus()
  Enable: uint8
  X_Angle: double
  Y_Angle: double

DunkBrakes_Init_TPDOs = Simulink.Bus()
  ClearError: uint8
  DeviceMode: uint8
  PowerEnable: uint8
  BrakeCtrl: uint8
  CurrentInit: double